# Grasshopper definition hairworm_basic_example.ghx (Grasshopper 0.9.64)
# plug-ins: Hairworm

# https://github.com/provolot/GrasshopperExchange/raw/master/Hairworm/_example_files/SphereMaker.ghcluster
# https://raw.github.com/provolot/GrasshopperExchange/master/Hairworm/_example_files/BoxSphereMakerVariableghx.ghx
panel = Panel("https://github.com/provolot/GrasshopperExchange/raw/master/Hairworm/_example_files/HexagridOnSrf.ghx")
number_slider = Slider(33, range=0..100)
panel_2 = Panel("3")
number_slider_2 = Slider(8, range=0..10)
geo = Geometry()
hairworm = Hairworm(ClusterURL=panel, Data=geo, Data_2=number_slider_2, Data_3=number_slider_2)  # -> Debug, Data, Data_2, Data_3
geo_2 = Geometry(hairworm.Data)
geo_3 = Geometry()
